# Dynamo graph LS_Occupant Load Factors_Fixed Override.dyn (Dynamo 2.12.0.5650)

# group: LS_Copy Occupant Load Factors
# note: Author: Dana De Filippi
# Version: 2.10
# Description:
# Areas are first filtered by Area Scheme name specified by the user.  Copies value from key parameter "LS Occupant Load Factor_Key" to the parameter used in the occupancy calculation "LS Occupant Load Factor".  Script also reviews the data in the "LS OL Factor Net Gross Fixed_Key" parameter and toggles the "LS Fixed Occupant Load" yes/no parameter so that the occupancy calculation will be the value specified by the user in the "LS_Occupancy Load Override" parameter.  Lastly, the script will make the value for the "LS_Fixed Occupancy Load Override" to 0 where not already specified by the user so that the calculation will populate (when areas are placed the override value defaults to blank breaking the calculation).

# group: SELECT AREAS
code_block = CodeBlock { "Areas"; }
byName = Category.ByName(name=code_block)
all_elements_of_category = ElementsOfCategory(Category=byName)

# group: SPECIFY AREA SCHEME NAME NODE: STRING
specify_area_scheme_name = StringInput("Occupancy Automation")

# group: FILTER AREAS BY AREA SCHEME
code_block_2 = CodeBlock { "Area Scheme Id"; }
getParameterValueByName = Element.GetParameterValueByName(element=all_elements_of_category, parameterName=code_block_2)
name = Element.Name(element=getParameterValueByName)
eq = name == specify_area_scheme_name
filterByBoolMask = List.FilterByBoolMask(list=all_elements_of_category, mask=eq)

# group: FIXED OL FACTOR
code_block_3 = CodeBlock(AREAS=filterByBoolMask.in) { AREAS; }
code_block_4 = CodeBlock { "LSP Fixed Occupant Load Override"; }
getParameterValueByName_2 = Element.GetParameterValueByName(element=code_block_3, parameterName=code_block_4)
string_from_object = FromObject(obj=getParameterValueByName_2)
code_block_5 = CodeBlock { "1"; }
eq_2 = string_from_object == code_block_5
filterByBoolMask_2 = List.FilterByBoolMask(list=code_block_3, mask=eq_2)
code_block_6 = CodeBlock { "LSP_OCC_Key_OL_Factor_Net_Gross_Fixed"; }
getParameterValueByName_3 = Element.GetParameterValueByName(element=filterByBoolMask_2.out, parameterName=code_block_6)
code_block_7 = CodeBlock { "FIXED"; }
eq_3 = getParameterValueByName_3 == code_block_7
boolean = BoolSelector(true)
boolean_2 = BoolSelector(false)

if_ = RefactoredIf(test=eq_3, true=boolean, false=boolean_2)

# group (continued): FIXED OL FACTOR
setParameterByName = Element.SetParameterByName(element=filterByBoolMask_2.out, parameterName=code_block_4, value=if_)

# group: OCCUPANCY LOAD OVERRIDE
code_block_8 = CodeBlock(AREAS=filterByBoolMask.in) { AREAS; }
code_block_9 = CodeBlock { "LSP Fixed Occupant Load"; }
getParameterValueByName_4 = Element.GetParameterValueByName(element=code_block_8, parameterName=code_block_9)
code_block_10 = CodeBlock { 0; }
gt = getParameterValueByName_4 > code_block_10
boolean_3 = BoolSelector(false)
isNull = Object.IsNull()  # unwired: object
replaceByCondition = Replace(item=gt, replaceWith=boolean_3, condition=isNull)
filterByBoolMask_3 = List.FilterByBoolMask(list=code_block_8, mask=replaceByCondition)
code_block_11 = CodeBlock { 0; }
setParameterByName_2 = Element.SetParameterByName(element=filterByBoolMask_3.out, parameterName=code_block_9, value=code_block_11)

# group: COUNT OF FIXED AREAS WITH NO "LS Fixed Occupant Load" SPECIFIED
countTrue = List.CountTrue(list=if_)
count_of_fixed_areas_without = Watch(countTrue)  # "COUNT OF FIXED AREAS (WITHOUT OVERRIDE)"; graph output

# group: COUNT OF TOTAL AREAS
count = List.Count(list=filterByBoolMask.in)
count_of_total_areas = Watch(count)  # graph output

# group: OCCUPANCY LOAD FACTOR
code_block_12 = CodeBlock { "LSP_OCC_Occupant_Load_Factor"; }
code_block_13 = CodeBlock { "LSP_OCC_Key_Occupant_Load_Factor"; }
getParameterValueByName_5 = Element.GetParameterValueByName(element=filterByBoolMask.in, parameterName=code_block_13)
toNumber = String.ToNumber(string=getParameterValueByName_5)
setParameterByName_3 = Element.SetParameterByName(element=filterByBoolMask.in, parameterName=code_block_12, value=toNumber)

watch = Watch(setParameterByName_3)

# group: CONTROLLED ALT. OCCUPANT LOAD
code_block_14 = CodeBlock(AREAS=filterByBoolMask.in) { AREAS; }
code_block_15 = CodeBlock { "Controlled Alt. Occupant Load"; }
getParameterValueByName_6 = Element.GetParameterValueByName(element=code_block_14, parameterName=code_block_15)
code_block_16 = CodeBlock { 0; }
gt_2 = getParameterValueByName_6 > code_block_16
boolean_4 = BoolSelector(false)
isNull_2 = Object.IsNull()  # unwired: object
replaceByCondition_2 = Replace(item=gt_2, replaceWith=boolean_4, condition=isNull_2)
filterByBoolMask_4 = List.FilterByBoolMask(list=code_block_14, mask=replaceByCondition_2)
code_block_17 = CodeBlock { 0; }
setParameterByName_4 = Element.SetParameterByName(element=filterByBoolMask_4.out, parameterName=code_block_15, value=code_block_17)
