# Dynamo graph LS_Set Up Function Of Space Key.dyn (Dynamo 2.12.0.5650)
# packages: BumbleBee 2019.2.1, archi-lab.net 2019.2.27

# group: LS_Set Up Function Of Space Key
# note: AUTHOR: Dana De Filippi
# VERSION: 2.20
# CUSTOM PACKAGE(S):
# BumbleBee v.2019.2.1
# archilab v.2019.2.27
# DESCRIPTION:
# Populates Area Schedule Keys from an excel file.
# User inputs (pink groups) for code type, code year (both used for sheet name), excel file location, and key schedule name.

# group: SPECIFY KEY SCHEDULE
# note: Input Type: Views
key_schedule_view_name = Views("LSP Key Schedule (Occupant Load Automation)")  # graph input

# group: SPECIFY EXCEL FILE
# note: Input Type: File Path
specify_excel_file_with_area = Filename("C:\Users\ttabassum\Documents\Occupancy\Gilead Wellness Model\LS_Set Up Function Of Space Key.xlsx")  # "Specify Excel File with Area Fuctions"; graph input

# group: SPECIFY CODE TYPE
# note: Input Type: String
specify_code_type_ibc_nfpa_101 = StringInput("IBC")  # graph input

# group: SPECIFY CODE YEAR
# note: Input Type: String
specify_code_year_2012_2015_2018 = StringInput("2018")  # graph input

# group: READS EXCEL
code_block = CodeBlock { true; false; "A2"; }
toUpper = String.ToUpper(string=specify_code_type_ibc_nfpa_101)
code_block_2 = CodeBlock { " "; }
concat = String.Concat(string0=toUpper, string1=code_block_2, string2=specify_code_year_2012_2015_2018)

# group: LAST CELL IN TABLE
code_block_3 = CodeBlock { "true"; "F1"; "F2"; }
# note: Custom Node: BumbleBee v.2019.2.1
read_excel = Custom[Read Excel](filePath=specify_excel_file_with_area, runIt=code_block_3.out0, sheetName=concat, origin=code_block_3.out1, extent=code_block_3.out2)  # package BumbleBee; This node will read an excel file. You can read an entore sheet contents, read from specific origin cell, read only specific range, or do all of the former for multiple sheets at the same time.
flatten = List.Flatten(list=read_excel)
code_block_4 = CodeBlock { 1; }
getItemAtIndex = List.GetItemAtIndex(list=flatten, index=code_block_4)

# group (continued): READS EXCEL
# note: Custom Node: BumbleBee v.2019.2.1
read_excel_2 = Custom[Read Excel](filePath=specify_excel_file_with_area, runIt=code_block.out0, sheetName=concat, byColumn=code_block.out1, origin=code_block.out2, extent=getItemAtIndex)

# group: WRITE TO KEY SCHEDULE
code_block_5 = CodeBlock { ["Key Name","LSP_OCC_Key_Occupant_Load_Factor","LSP_OCC_Key_OL_Factor_Net_Gross_Fixed","LSP_OCC_Key_Code_Source"]; }
boolean = BoolSelector(true)
# note: Custom Node: archilab v.2019.2.27
key_schedule = Custom[Key Schedule](viewSchedule=key_schedule_view_name, data=read_excel_2, parameterNames=code_block_5, upperCase=boolean)  # package archi-lab.net; This node will take a key schedule, data and a list of parameters and populate it with infomation from data parameter. Visit www.archi-lab.net for more information on how to prep this node for take off.

# group: SCHEDULE KEYS CREATED
firstItem = List.FirstItem(list=read_excel_2@L1)
schedule_keys_created = Watch(firstItem)  # graph output
